# Dynamo graph HH_CADCleaner.dyn (Dynamo 1.3.4.6666)

boolean = BoolSelector(false)
reportInstances = CAD.ReportInstances(arg1=boolean)
watch = Watch(reportInstances)
delete = archilab.Revit.Elements.Elements.Delete(watch)  # frozen
