# Dynamo graph HH_DetailLayout_24X36.dyn (Dynamo 1.3.4.6666)

# note: Hart Howerton Dynamo Script Colour Coding

# group: AUTOMATED DETAIL LAYOUT
# note: DEPENDENCIES ________________________________________________________
# -None
# note: DESCRIPTION
# This script automates the creation of detail sheets and placing detail views. Desired detail views should be inserted into the file prior to running. Please be sure the required Reference Plane box (variable width x 10 3/8” height) is present in all detail views. This will allow for proper placement of view titles.
# Before running, create a dummy sheet with the desired Titleblock and open that sheet view.  You will then be prompted to select the upper and lower bounds of the available window on the sheet. The script will then create the sheets for you.
# note: DYNAMO VERSION
# [1.0.0]
# note: REVIT VERSION(S)
# [2017-2019]
# note: DYNAMO FILE NAME
# [DetailLayout_X.X.dyn]

# group: OPERATIONS
# note: Procedures required to run the script

# group: OUTPUTS
# note: Outputs at the end of the script

# group: INPUTS
# note: User Inputs Required

# group: PYTHON INPUTS
sheet_name = StringInput("DETAILS")
sheet_number = IntegerSlider(13, range=0..1000 step 1)
titleblock = DSModelElementSelection()
type = FamilyInstance.Type(titleblock)
columns = IntegerSlider(3, range=0..100 step 1)
rows = IntegerSlider(2, range=0..100 step 1)
sheet_number_pretext = StringInput("A6.")
vertical_view_shift = CodeBlock { -0.04; }
title_lines_gap = CodeBlock()
# ---------- title_lines_gap.designscript (2 lines) ----------
0.08333;
 //1";
# ----------------------------------------

# group: ISOLATES VIEWS TO GO ON SHEETS
element_types = ElementTypes("ViewDrafting")
all_elements_of_type = ElementsOfType(element_types)
code_block = CodeBlock { "HH View Type"; }
getParameterValueByName = Element.GetParameterValueByName(element=all_elements_of_type, parameterName=code_block)
code_block_2 = CodeBlock { "04-Documentation"; }
boolean = BoolSelector(true)
contains = String.Contains(str=getParameterValueByName, searchFor=code_block_2, ignoreCase=boolean)
filterByBoolMask = List.FilterByBoolMask(list=all_elements_of_type, mask=contains)
code_block_3 = CodeBlock { "HH View Subgroup"; }
getParameterValueByName_2 = Element.GetParameterValueByName(element=filterByBoolMask.in, parameterName=code_block_3)
detail_location = StringInput("Details")
boolean_2 = BoolSelector(true)
contains_2 = String.Contains(str=getParameterValueByName_2, searchFor=detail_location, ignoreCase=boolean_2)
filterByBoolMask_2 = List.FilterByBoolMask(list=filterByBoolMask.in, mask=contains_2)
code_block_4 = CodeBlock { "HH View Subtype"; }
getParameterValueByName_3 = Element.GetParameterValueByName(element=filterByBoolMask_2.in, parameterName=code_block_4)
detail_type = StringInput("Roof_Metal")
boolean_3 = BoolSelector(true)
contains_3 = String.Contains(str=getParameterValueByName_3, searchFor=detail_type, ignoreCase=boolean_3)
filterByBoolMask_3 = List.FilterByBoolMask(list=filterByBoolMask_2.in, mask=contains_3)
sortNatural = Orchid.Generic.Core.List.SortNatural(filterByBoolMask_3.in)

# group: SHEETS MADE VIA PYTHON INPUTS AND FILTERED VIEWS
python_script = Python(IN[0]=sheet_name, IN[1]=sheet_number, IN[2]=type, IN[3]=columns, IN[4]=rows, IN[5]=sortNatural, IN[6]=sheet_number_pretext, IN[7]=vertical_view_shift, IN[8]=title_lines_gap)
# ---------- python_script.python (175 lines) ----------
import clr
clr.AddReference('RevitAPI')
from Autodesk.Revit.DB import *
from Autodesk.Revit.DB.Events import *
import Autodesk

clr.AddReference('RevitAPIUI')
from Autodesk.Revit.UI import TaskDialog
from Autodesk.Revit.UI.Selection import *


clr.AddReference("RevitNodes")
import Revit
clr.ImportExtensions(Revit.Elements)
clr.ImportExtensions(Revit.GeometryConversion)
 
clr.AddReference("RevitServices")
import RevitServices
from RevitServices.Persistence import DocumentManager
from RevitServices.Transactions import TransactionManager
 
doc = DocumentManager.Instance.CurrentDBDocument
uidoc = DocumentManager.Instance.CurrentUIApplication.ActiveUIDocument

sheetname = IN[0] #String
sheetnum = IN[1] #Integer
titleblock = UnwrapElement(IN[2]) #unwrapped titleblock
cols = IN[3]
rows = IN[4]
views = IN[5] 
namingsub = IN[6]
yshift = IN[7]
tgap = IN[8] #vertical gap for titleblock lines - 1" in imperial

viewsPP = rows*cols #views per page
viewCountTotal = 0 #total views
widthList = []
viewlist = []

#Function to get the width of a viewport. Needs to be placed first, measured, then deleted.
def vpWidth(vp):
	basePt = XYZ(0,0,0)
	newVP = Viewport.Create(doc,doc.ActiveView.Id, Autodesk.Revit.DB.ElementId(vp.Id),basePt)
	bbox = newVP.BoundingBox[doc.ActiveView]
	vpwidth = bbox.Max.ToPoint().X - bbox.Min.ToPoint().X
	doc.ActiveView.DeleteViewport(newVP)
	return vpwidth

#Function to draw all the placement pts on a sheet
def ptlist(ptList):
	for j in range(rows*2+1):
		for i in range(cols*2+1):
			if (i % 2 !=0 and j % 2 !=0):
				x = ptA.X + i * dx
				y = ptA.Y - j * dy
				ptList.append(UV(x, y))

#Function to draw vertical lines next to cells
def makevertline(popPt, newsheet):
	newX = popPt.X+dx
	startpt = XYZ(newX, popPt.Y+dy,0)
	endpt = XYZ(newX, popPt.Y-dy,0)
	l = Line.CreateBound(startpt, endpt)
	detcurve = doc.Create.NewDetailCurve(newsheet, l)

#Function to draw horizontal lines next to cells
def makehorzline(popPt, newsheet):
	startpt = XYZ(popPt.X-dx, popPt.Y-dy,0)
	endpt = XYZ(popPt.X+dx, popPt.Y-dy,0)
	l = Line.CreateBound(startpt, endpt)
	detcurve = doc.Create.NewDetailCurve(newsheet, l)
	
	startpt = XYZ(popPt.X-dx, popPt.Y+tgap-dy,0)
	endpt = XYZ(popPt.X+dx, popPt.Y+tgap-dy,0)
	l = Line.CreateBound(startpt, endpt)
	detcurve = doc.Create.NewDetailCurve(newsheet, l)

#Function to draw all horizontal lines on a sheet
def makelines(crvlist, newsheet):

		for i in range(rows):
			startpt = XYZ(ptA.X, ptA.Y-(i+1)*dy*2+tgap, 0) #vertical offset for titles
			endpt = XYZ(ptA.X+sheetWidth, ptA.Y-(i+1)*dy*2+tgap, 0) #vertical offset for titles
			l = Line.CreateBound(startpt, endpt)
			detcurve = doc.Create.NewDetailCurve(newsheet, l)
			crvlist.append(detcurve)

			startpt = XYZ(ptA.X, ptA.Y-(i+1)*dy*2, 0)
			endpt = XYZ(ptA.X+sheetWidth, ptA.Y-(i+1)*dy*2, 0)
			l = Line.CreateBound(startpt, endpt)
			detcurve = doc.Create.NewDetailCurve(newsheet, l)
			crvlist.append(detcurve)

for i in views:
	viewlist.append(UnwrapElement(i))

TaskDialog.Show("BH Tools", "Close the dialog and pick upper left corner of viewport followed by the lower right corner.")
ptA = uidoc.Selection.PickPoint(ObjectSnapTypes.Endpoints, "Pick point A")
#TaskDialog.Show("BH Tools", "Close the dialog and pick lower right point of viewport")
ptB = uidoc.Selection.PickPoint(ObjectSnapTypes.Endpoints, "Pick point B")

sheetWidth = ptB.X - ptA.X
sheetHeight = ptA.Y - ptB.Y
dx = sheetWidth/(cols*2)
dy = sheetHeight/(rows*2)

spaceLeft = False
sheetNumCount = 0
popIndex = 0 #index of placement point on page

vWidthlist =[]
spacedistlist = []

TransactionManager.Instance.EnsureInTransaction(doc)

for item in viewlist:
	
	if spaceLeft == False:
		newsheet = ViewSheet.Create(doc,titleblock.Id)# create new sheet where titleblock.Id is the id of the titleblock
		newsheet.Name = sheetname
		newsheet.SheetNumber = namingsub + str(sheetnum + sheetNumCount)
		crvlist = []
		ptList = []
		#makelines(crvlist,newsheet)
		ptlist(ptList)
		sheetNumCount+=1
		spaceLeft = True
	
	placept = XYZ(ptList[popIndex].U, ptList[popIndex].V, 0)
	ppYshift = placept.Y-yshift
	placept = XYZ(placept.X, ppYshift, 0)
	vWidth = vpWidth(views[viewlist.index(item)])
	
	vWidthlist.append(vWidth)
	spaceDist = ptB.X-placept.X+dx
	spacedistlist.append(spaceDist)
	
	if vWidth < (2*dx):	#if view is a single width cell
		newVP = Viewport.Create(doc,newsheet.Id, item.Id, placept)		
		newY = placept.Y+yshift
		popPt = XYZ(placept.X, newY, 0) #point for vert line reference
		makevertline(popPt, newsheet)
		makehorzline(popPt, newsheet)			
		popIndex +=1
	elif vWidth > (2*dx) and vWidth < spaceDist: #if view is a double width cell
		newX = placept.X+dx
		placept = XYZ(newX, placept.Y, 0)
		newVP = Viewport.Create(doc,newsheet.Id, item.Id, placept)		
		popPt = XYZ(ptList[popIndex+1].U, ptList[popIndex+1].V, 0) #point for vert line reference
		makevertline(popPt, newsheet)
		makehorzline(popPt, newsheet)		
		popIndex +=2
	elif vWidth >(2*dx) and vWidth > spaceDist: #if the view is double width and there is not enough space
		if popIndex < cols * (rows-1):
			newPP = XYZ(ptList[popIndex+1].U, ptList[popIndex+1].V, 0)
			newX = newPP.X+dx
			newY = newPP.Y -yshift
			placept = XYZ(newX, newY, 0)
			newVP = Viewport.Create(doc,newsheet.Id, item.Id, placept)		
			popPt = XYZ(ptList[popIndex+2].U, ptList[popIndex+2].V, 0) #point for vert line reference
			makevertline(popPt, newsheet)
			makehorzline(popPt, newsheet)
			popIndex +=3
		else: 
			spaceLeft = False
			popIndex=0
	
	if popIndex > viewsPP-1:
		spaceLeft = False
		popIndex = 0
	
TransactionManager.Instance.TransactionTaskDone()			

#OUT = [widthTest, bboxmaxList, viewsonSheet, sheetlist, sheetTotal, viewCount, viewCountMax, len(viewlist), len(ptlist), detcurves, ptA, ptB]
OUT = [vWidthlist, spacedistlist]
# ----------------------------------------
code_block_5 = CodeBlock(list=python_script) { list[0]; list[1]; }
