# Dynamo graph HH_LinePatternWiper.dyn (Dynamo 1.3.4.6666)

# note: OPERATIONS
# note: OUTPUTS
# note: INPUTS

# group: Impoted Line Pattern Wiper
# note: DYNAMO VERSION
# [1.3.3]
# note: REVIT VERSION(S)
# [2017-2019]
# note: This script removes all imported line patterns from a Revit file.
# note: DEPENDENCIES ________________________________________________________
# Python script
# note: HH_LinePatternWiper.dyn

# group: Find all Line Pattern Elements in File
element_types = ElementTypes("LinePatternElement")
all_elements_of_type = ElementsOfType(element_types)

# group: Tracks Quantity of Line Patterns in File
count = List.Count(all_elements_of_type)
watch = Watch(count)

# group: Filters out the Imported Line Patterns
name = Element.Name(all_elements_of_type)
code_block = CodeBlock { "IMPORT"; false; }
contains = String.Contains(str=name, searchFor=code_block.out0, ignoreCase=code_block.out1)
filterByBoolMask = List.FilterByBoolMask(list=all_elements_of_type, mask=contains)

# group: Python Script Deletes Imported Line Patterns
python_script = Python(IN[0]=filterByBoolMask.in)  # unwired: IN[1]
# ---------- python_script.python (47 lines) ----------
#Copyright(c) 2014, Konrad Sobon
# @arch_laboratory, http://archi-lab.net

import clr
clr.AddReference('ProtoGeometry')
from Autodesk.DesignScript.Geometry import *

# Import DocumentManager and TransactionManager
clr.AddReference("RevitServices")
import RevitServices
from RevitServices.Persistence import DocumentManager
from RevitServices.Transactions import TransactionManager

# Import RevitAPI
clr.AddReference("RevitAPI")
import Autodesk
from Autodesk.Revit.DB import *

doc = DocumentManager.Instance.CurrentDBDocument
uiapp = DocumentManager.Instance.CurrentUIApplication
app = uiapp.Application

from System.Collections.Generic import *

#The inputs to this node will be stored as a list in the IN variable.
dataEnteringNode = IN

#unwrap all elements to use with API
elements = []
for i in IN[0]:
	elements.append(UnwrapElement(i))

idsToDelete = List[Autodesk.Revit.DB.ElementId]()
for i in elements:
	idsToDelete.Add(i.Id)

# "Start" the transaction
TransactionManager.Instance.EnsureInTransaction(doc)

doc.Delete(idsToDelete)

# "End" the transaction
TransactionManager.Instance.TransactionTaskDone()

message = "You have successfully deleted n " + str(idsToDelete.Count) + " elements from Revit model."

OUT = 'n'.join('{:^35}'.format(s) for s in message.split('n'))
# ----------------------------------------
watch_2 = Watch(python_script)

# group: List of Line Pattern Names
name_2 = Element.Name(all_elements_of_type)
watch_3 = Watch(name_2)
