# Dynamo graph HH_PlanGenerator.dyn (Dynamo 1.3.3.4111)

# note: Hart Howerton Dynamo Script Colour Coding

# group: Plan View Generator
# note: DEPENDENCIES ________________________________________________________
# archi-lab.net (2018.0.8 build)
# note: DESCRIPTION
# This script automates the creation of multiple plan views by view type, per level and applies view templates to them so they self-sort into the proper locations in the Project Browser. Levels should created prior to running this script. Please double-check Plan Types and related View Templates prior to running the script to ensure all view types necessary for the project are being addressed. Also, please note that there are two different streams for the script: one for floor plans and one for RCPs. Both of these need to be checked before running.
# note: REVIT VERSION(S)
# 2017, 2018, 2019
# note: DYNAMO VERSION
# [1.3.3]
# note: DYNAMO FILE NAME
# PlanGenerator.dyn
# note: AUTHOR
# [Jessica Brams-Miller]

# group: OPERATIONS
# note: Procedures required to run the script

# group: OUTPUTS
# note: Outputs at the end of the script

# group: INPUTS
# note: User Inputs Required

# group: LEVEL SELECTION
categories = Categories("Levels")
all_elements_of_category = ElementsOfCategory(categories)

# group: FP DESIGNATIONS AND ASSOCIATED VIEW TEMPLATES
view_name = CodeBlock { "A-WRK-XX-FP"; "A-COO-FP"; "A-PRES-FP"; "A-DOC-FP"; }
view_templates = ViewTemplatesUi("HH_WRK_FP_1/8\"=1'-0\"")
view_templates_2 = ViewTemplatesUi("HH_COO_FP_1/8\"=1'-0\"")
view_templates_3 = ViewTemplatesUi("HH_PRES_FP_1/8\"=1'-0\"")
view_templates_4 = ViewTemplatesUi("HH_DOC_FP_1/8\"=1'-0\"")

# group: RCP DESIGNATIONS AND ASSOCIATED VIEW TEMPLATES
view_name_2 = CodeBlock { "A-WRK-XX-CP"; "A-COO-CP"; "A-PRES-CP"; "A-DOC-CP"; }
view_templates_5 = ViewTemplatesUi("HH_WRK_CP_1/8\"=1'-0\"")
view_templates_6 = ViewTemplatesUi("HH_COO_CP_1/8\"=1'-0\"")
view_templates_7 = ViewTemplatesUi("HH_PRES_CP_1/8\"=1'-0\"")
view_templates_8 = ViewTemplatesUi("HH_DOC_CP_1/8\"=1'")

# group: LISTS CREATED FROM RCP/FP DESIGNATIONS AND VIEW TEMPLATES
create = List.Create(view_name.out0, view_name.out1, view_name.out2, view_name.out3)
create_2 = List.Create(view_templates, view_templates_2, view_templates_3, view_templates_4)
create_3 = List.Create(view_name_2.out0, view_name_2.out1, view_name_2.out2, view_name_2.out3)
create_4 = List.Create(view_templates_5, view_templates_6, view_templates_7, view_templates_8)

# group: CREATE AND NAME FP VIEWS PER LEVEL
code_block = CodeBlock(levels=all_elements_of_category, view_type=create) { levels; view_type; }
count = Count(code_block.view_type)
ofRepeatedItem = List.OfRepeatedItem(item=code_block.levels, amount=count, lacing=Longest)
byLevel = FloorPlanView.ByLevel(ofRepeatedItem)
code_block_2 = CodeBlock { "View Name"; }
name = Level.Name(code_block.levels)
code_block_3 = CodeBlock(x=code_block.view_type, y=name) { x<0> + "_" + y<1>; }
setParameterByName = Element.SetParameterByName(element=byLevel, parameterName=code_block_2, value=code_block_3)
transpose = List.Transpose(setParameterByName)
flatten = Flatten(transpose)

# group: APPLY VIEW TEMPLATE TO VIEWS
code_block_4 = CodeBlock(levels=all_elements_of_category, view_template=create_2) { levels; view_template; }
count_2 = Count(code_block_4.levels)
ofRepeatedItem_2 = List.OfRepeatedItem(item=code_block_4.view_template, amount=count_2)
transpose_2 = List.Transpose(ofRepeatedItem_2)
flatten_2 = Flatten(transpose_2)

# group: CREATE AND NAME RCP VIEWS PER LEVEL
code_block_5 = CodeBlock(levels=all_elements_of_category, view_type=create_3) { levels; view_type; }
count_3 = Count(code_block_5.view_type)
ofRepeatedItem_3 = List.OfRepeatedItem(item=code_block_5.levels, amount=count_3, lacing=Longest)
byLevel_2 = CeilingPlanView.ByLevel(ofRepeatedItem_3)
code_block_6 = CodeBlock { "View Name"; }
name_2 = Level.Name(code_block_5.levels)
code_block_7 = CodeBlock(x=code_block_5.view_type, y=name_2) { x<0> + "_" + y<1>; }
setParameterByName_2 = Element.SetParameterByName(element=byLevel_2, parameterName=code_block_6, value=code_block_7)
transpose_3 = List.Transpose(setParameterByName_2)
flatten_3 = Flatten(transpose_3)

# group: APPLY VIEW TEMPLATE TO VIEWS
code_block_8 = CodeBlock(levels=all_elements_of_category, view_template=create_4) { levels; view_template; }
count_4 = Count(code_block_8.levels)
ofRepeatedItem_4 = List.OfRepeatedItem(item=code_block_8.view_template, amount=count_4)
transpose_4 = List.Transpose(ofRepeatedItem_4)
flatten_4 = Flatten(transpose_4)

# group: VIEW TEMPLATES APPLIED
setViewTemplate = archilab.Revit.Views.Views.SetViewTemplate()  # unwired: arg0, arg1
laceShortest = List.LaceShortest(setViewTemplate, flatten, flatten_2)
setViewTemplate_2 = archilab.Revit.Views.Views.SetViewTemplate()  # unwired: arg0, arg1
laceShortest_2 = List.LaceShortest(setViewTemplate_2, flatten_3, flatten_4)

# group: ASSOCIATED LEVEL CHECK - RCP
code_block_9 = CodeBlock { "Associated Level"; }
getParameterValueByName = Element.GetParameterValueByName(element=setParameterByName_2, parameterName=code_block_9)
watch = Watch(getParameterValueByName)

# group: ASSOCIATED LEVEL CHECK - FP
code_block_10 = CodeBlock { "Associated Level"; }
getParameterValueByName_2 = Element.GetParameterValueByName(element=setParameterByName, parameterName=code_block_10)
watch_2 = Watch(getParameterValueByName_2)
