# Dynamo graph HH_PlanGenerator_LA_2.dyn (Dynamo 2.3.0.5885)
# packages: archi-lab.net 2020.23.5

# note: Hart Howerton Dynamo Script Colour Coding

# group: LA Plan View Generator
# note: DEPENDENCIES ________________________________________________________
# archi-lab.net (2018.0.8 build)
# note: DESCRIPTION
# This script automates the creation of multiple plan views by view type, per level and applies view templates to them so they self-sort into the proper locations in the Project Browser. Levels should created prior to running this script. Please double-check Plan Types and related View Templates prior to running the script to ensure all view types necessary for the project are being addressed.
# note: REVIT VERSION(S)
# 2017, 2018, 2019
# note: DYNAMO VERSION
# [2.0.2]
# note: DYNAMO FILE NAME
# HH_PlanGenerator_LA.dyn
# note: AUTHOR
# [Jessica Brams-Miller]

# group: OPERATIONS
# note: Procedures required to run the script

# group: OUTPUTS
# note: Outputs at the end of the script

# group: INPUTS
# note: User Inputs Required

# group: LEVEL SELECTION
categories = Categories("OST_LevelHeads")  # graph input
all_elements_of_category = ElementsOfCategory(Category=categories)

# group: FP DESIGNATIONS AND ASSOCIATED VIEW TEMPLATES
view_name = CodeBlock()
# ---------- view_name.designscript (12 lines) ----------
"LA-DOC-PP_TREES";
"LA-DOC-PP_SHRUBS & GC";
"LA-DOC-MP";
"LA-DOC-SP";
"LA-DOC-LP";
"LA-DOC-TPP";
"LA-PRES-LINEWORK";
"LA-PRES-TREES";
"LA-PRES-FURN";
"LA-PRES-FINAL";
"LA-PRES-SURVEY";
"LA-WRK-XX";
# ----------------------------------------
view_templates = ViewTemplatesUi("HH_COO_EL_1/8\"=1'-0\"")  # graph input
view_templates_2 = ViewTemplatesUi("HH_COO_CP_1/8\"=1'-0\"")  # graph input
view_templates_3 = ViewTemplatesUi("HH_COO_CP_1\"=20'-0\"")  # graph input
view_templates_4 = ViewTemplatesUi("HH_COO_FP_1\"=10'-0\"")  # graph input
view_templates_5 = ViewTemplatesUi("HH_COO_CP_1\"=10'-0\"")  # graph input
view_templates_6 = ViewTemplatesUi("HH_COO_FP_1/4\"=1'-0\"")  # graph input
view_templates_7 = ViewTemplatesUi("HH_DOC_BS_1\"=10'-0\"")  # graph input
view_templates_8 = ViewTemplatesUi("HH_DOC_BS_1/4\"=1'-0\"")  # graph input
view_templates_9 = ViewTemplatesUi("HH_COO_SP_1\"=20'-0\"")  # graph input
view_templates_10 = ViewTemplatesUi("HH_COO_FP_1/8\"=1'-0\"")  # graph input
view_templates_11 = ViewTemplatesUi("HH_DOC_BS_1\"=20'-0\"")  # graph input
view_templates_12 = ViewTemplatesUi("HH_DOC_BS_1/8\"=1'-0\"")  # graph input

# group: LIST CREATION
list_create = List.Create(item0=view_name.out0, item1=view_name.out1, item2=view_name.out2, item3=view_name.out3, item4=view_name.out4, item5=view_name.out5, item6=view_name.out6, item7=view_name.out7, item8=view_name.out8, item9=view_name.out9, item10=view_name.out10, item11=view_name.out11)
list_create_2 = List.Create(item0=view_templates, item1=view_templates_2, item2=view_templates_3, item3=view_templates_4, item4=view_templates_5, item5=view_templates_6, item6=view_templates_7, item7=view_templates_8, item8=view_templates_9, item9=view_templates_10, item10=view_templates_11, item11=view_templates_12)

# group: CREATE AND NAME FP VIEWS PER LEVEL
code_block = CodeBlock(levels=all_elements_of_category, view_type=list_create) { levels; view_type; }
count = List.Count(list=code_block.view_type)
ofRepeatedItem = List.OfRepeatedItem(item=code_block.levels, amount=count, lacing=Longest)
byLevel = FloorPlanView.ByLevel(level=ofRepeatedItem)
code_block_2 = CodeBlock { "View Name"; }
name = Level.Name(level=code_block.levels)
code_block_3 = CodeBlock(x=code_block.view_type, y=name) { x<0> + "_" + y<1>; }
setParameterByName = Element.SetParameterByName(element=byLevel, parameterName=code_block_2, value=code_block_3)
transpose = List.Transpose(lists=setParameterByName)
flatten = List.Flatten(list=transpose)

# group: ASSOCIATED LEVEL CHECK - FP
code_block_4 = CodeBlock { "Associated Level"; }
getParameterValueByName = Element.GetParameterValueByName(element=setParameterByName, parameterName=code_block_4)
watch = Watch(getParameterValueByName)

# group: APPLY VIEW TEMPLATE TO VIEWS
code_block_5 = CodeBlock(levels=all_elements_of_category, view_template=list_create_2) { levels; view_template; }
count_2 = List.Count(list=code_block_5.levels)
ofRepeatedItem_2 = List.OfRepeatedItem(item=code_block_5.view_template, amount=count_2)
transpose_2 = List.Transpose(lists=ofRepeatedItem_2)
flatten_2 = List.Flatten(list=transpose_2)

# group: VIEW TEMPLATES APPLIED
setViewTemplate = archilab.Revit.Views.Views.SetViewTemplate()  # unwired: view, viewTemplate
laceShortest = List.LaceShortest(comb=setViewTemplate, list1=flatten, list2=flatten_2)
