# Dynamo graph HH_RandomRotator_ByObjectSelection.dyn (Dynamo 1.3.4.6666)

# note: Hart Howerton Dynamo Script Colour Coding

# group: OBJECT RANDOM ROTATOR
# note: DEPENDENCIES ________________________________________________________
# None
# note: DESCRIPTION
# User selects objects for rotation. Script randomizes rotation angle and sets it.
# note: REVIT BUILD(S)
# 2017-2019
# note: DYNAMO VERSION
# 2.0.2
# note: DYNAMO FILE NAME
# RandomRotator_ByObjectSelection.dyn
# note: AUTHOR
# Jessica Brams-Miller

# group: OPERATIONS
# note: Procedures required to run the script

# group: OUTPUTS
# note: Outputs at the end of the script

# group: INPUTS
# note: User Inputs Required

# group: Object Selection by User
select_model_elements = DSModelElementsSelection()  # 6 picked in the model

# group: Objects' rotations turned into a list and randomized
code_block = CodeBlock { 0; 180; }
count = Count(select_model_elements)
ofRepeatedItem = List.OfRepeatedItem(item=code_block.out0, amount=count)
random = Math.Random(ofRepeatedItem, code_block.out1)

# group: Objects' randomized rotation set
setRotation = FamilyInstance.SetRotation(familyInstance=select_model_elements, degree=random)
