# Dynamo graph ImportCADToFamily.dyn (Dynamo 2.0.2.6826)

element_types = ElementTypes(index=160)  # graph input
file_path = Filename(".\Doors_TEST.dwg")  # graph input
views = Views()  # nothing selected; graph input
python_script = Python(IN[0]=file_path, IN[1]=views)
# ---------- python_script.python (40 lines) ----------
import clr
clr.AddReference('ProtoGeometry')
from Autodesk.DesignScript.Geometry import *

# Import DocumentManager and TransactionManager
clr.AddReference("RevitServices")
import RevitServices
from RevitServices.Persistence import DocumentManager
from RevitServices.Transactions import TransactionManager

doc = DocumentManager.Instance.CurrentDBDocument
uiapp = DocumentManager.Instance.CurrentUIApplication
app = uiapp.Application

# Import RevitAPI
clr.AddReference("RevitAPI")
import Autodesk
from Autodesk.Revit.DB import *

#The inputs to this node will be stored as a list in the IN variables.
dataEnteringNode = IN

filePath = IN[0]
view = UnwrapElement(IN[1])

options = DWGImportOptions()
options.AutoCorrectAlmostVHLines = True
options.ColorMode = ImportColorMode.BlackAndWhite
options.OrientToView = True
options.ThisViewOnly = True
options.VisibleLayersOnly = True

linkedElem = clr.Reference[ElementId]()

TransactionManager.Instance.EnsureInTransaction(doc)
doc.Link(filePath, options, view, linkedElem)
TransactionManager.Instance.TransactionTaskDone()

#Assign your output to the OUT variable.
OUT = filePath
# ----------------------------------------
string = StringInput("\")  # graph input
split = String.Split(str=python_script, separater0=string)
lastItem = List.LastItem(list=split)
passthrough = Custom[Passthrough](passThrough=element_types, waitFor=lastItem)  # Forces a sequential order of execution. The node wired into the output of the Passthrough node will be executed *after* the node wired into the waitFor input (e.g. important for some Revit operations). The value of the passThrough input will be passed on to the node wired into the output port of the Passthrough node.
all_elements_of_type = ElementsOfType(element_type=passthrough)
code_block = CodeBlock { "Name"; }
getParameterValueByName = Element.GetParameterValueByName(element=all_elements_of_type, parameterName=code_block)
code_block_2 = CodeBlock { ".dwg"; ""; }
replace = String.Replace(str=lastItem, searchFor=code_block_2.out0, replaceWith=code_block_2.out1)
contains = String.Contains(str=getParameterValueByName, searchFor=replace)
filterByBoolMask = List.FilterByBoolMask(list=all_elements_of_type, mask=contains)
hh_cad_layers = CodeBlock { "0"; "A-1"; "A-2"; "A-3"; "A-4"; "A-6"; "A-8"; "A-HATCH-WALLSEC"; "Defpoints"; }
create = List.Create(item0=hh_cad_layers.out0, item1=hh_cad_layers.out1, item2=hh_cad_layers.out2, item3=hh_cad_layers.out3, item4=hh_cad_layers.out4, item5=hh_cad_layers.out5, item6=hh_cad_layers.out6, item7=hh_cad_layers.out7, item8=hh_cad_layers.out8)
linestyle_names = CodeBlock()
# ---------- linestyle_names.designscript (9 lines) ----------
"_HH_Pen 01";
"_HH_Pen 01";
"_HH_Pen 02";
"_HH_Pen 03";
"_HH_Pen 04";
"_HH_Pen 06";
"_HH_Pen 02_Gray";
"_HH_Pen 02_Gray";
"Z-NPLT";
# ----------------------------------------
create_2 = List.Create(item0=linestyle_names.out0, item1=linestyle_names.out1, item2=linestyle_names.out2, item3=linestyle_names.out3, item4=linestyle_names.out4, item5=linestyle_names.out5, item6=linestyle_names.out6, item7=linestyle_names.out7, item8=linestyle_names.out8)
symbolicCurvesFromCADLayers = CAD.SymbolicCurvesFromCADLayers(importInstance=filterByBoolMask.in, layerNames=create, lineStyleMap=create_2)
watch = Watch(symbolicCurvesFromCADLayers.SymbolicCurve)
watch_2 = Watch(all_elements_of_type)
watch_3 = Watch(replace)
watch_4 = Watch(filterByBoolMask.in)
layerNames = CAD.LayerNames(importInstance=watch_4)
check_layer_names = List.Sort(list=layerNames)
