# Dynamo graph PanelRandomizer_A.dyn (Dynamo 1.3.4.6666)

# note: Hart Howerton Dynamo Script Colour Coding

# group: PANEL RANDOMIZER
# note: DEPENDENCIES ________________________________________________________
# Lunchbox (install via https://provingground.io/tools/lunchbox/download-lunchbox-for-grasshopper/),
# Clockwork
# note: DESCRIPTION
# This script will randomize the list of curtain panel types (chosen by the user) across the stretch of a curtain wall. It will incorporate all instances of the family types specified, so the user MUST be specific and surgical in the panels he/she/they chooses to use as inputs for this script.
# note: REVIT BUILD(S)
# 2017, 2018, 2019
# note: DYNAMO VERSION
# [1.3.3]
# note: AUTHOR
# Jessica Brams-Miller
# note: DYNAMO FILE NAME
# PanelRandomizer_A

# group: OPERATIONS
# note: Procedures required to run the script

# group: OUTPUTS
# note: Outputs at the end of the script

# group: INPUTS
# note: User Inputs Required

# group: Choose a different panel type for each input
family_types = FamilyTypes("TestPanel_Louver:Type 1 - 90 Deg_3\" spacing")
family_types_2 = FamilyTypes("TestPanel_Louver:Type 2 - 90 Deg_6\" Spacing")
family_types_3 = FamilyTypes("TestPanel_Louver:Type 3 - 90 Deg_9\" Spacing")
family_types_4 = FamilyTypes("TestPanel_Louver:Type 4 - 90 Deg_12\" Spacing")

# group: Creates list of panel types and randomizes based on min/max and seed. List is rounded and reused to choose the type from the original list.
create = List.Create(family_types, family_types_2, family_types_3, family_types_4)
all_elements_of_family_type = ElementsOfFamilyType(create)
flatten = Flatten(all_elements_of_family_type)
count = List.Count(all_elements_of_family_type)
code_block = CodeBlock(x=count) { -0.5; x-0.6; }
count_2 = List.Count(flatten)
integer_slider = IntegerSlider(43, range=0..50 step 1)
lunchbox_random_numbers = Custom[LunchBox Random Numbers](Min=code_block.out0, Max=code_block.out1, Amount=count_2, Seed=integer_slider)  # Generates a list of Random numbers using a domain, amount, and seed.
round = Math.Round(lunchbox_random_numbers)
getItemAtIndex = List.GetItemAtIndex(list=create, index=round)

# group: Panel types reset from the randomized list.
setType = Custom[FamilyInstance.SetType](familyInstance=flatten, familyType=getItemAtIndex)  # Changes the family type of a given family instance to the specified type
watch = Watch(setType.familyInstance)

# group: Initial list of curtain panel types in use.
watch_2 = Watch(create)
