# Dynamo graph WorksetCreator.dyn (Dynamo 2.3.0.5885)

# note: OPERATIONS
# note: INPUTS
# note: OUTPUTS

# group: WORKSET CREATOR
# note: DEPENDENCIES ________________________________________________________
# -None
# note: This script automates the creation of worksets during project setup. It reads from a central Excel file located on the (T:) drive.
# To Use:
# 1) Check location of Excel workset file in "File Path" node.
# 2) Check sheet in Excel file from which you want Dynamo to read. Change text in  "Desired Sheet" node to match. This IS case sensitive, so make sure the name of the sheet and the entry in this node match exactly.
# 3) Run.
# 4) Open worksets in Revit to double check that all desired worksets are present and accounted-for.
# NOTE:
# This script should only be run once on a project. If, for some reason during setup, you need to rerun the script, simply delete all of the numbered worksets and re-run the script.
# 5) Sync to Central and RELINQUISH ALL MINE before exiting your newly workshared project.
# note: DYNAMO VERSION
# [1.3.3]
# note: REVIT VERSION(S)
# [2017-2019]
# note: DYNAMO FILE NAME
# [WorksetCreator.dyn]

# group: SELECT WORKSET EXCEL FILE AND DESIRED SHEET
file_path = Filename("P:\2019\19-044 Belle Haven CC\3_CAD\3D\Revit\Support\HH_STANDARD WORKSETS.xlsx")  # graph input
desired_sheet = StringInput("Sheet1")  # graph input

# group: READ FROM FILE AND WORKSET LIST CREATION
fromPath = FileObject(path=file_path)  # "File.FromPath"
importExcel = Data.ImportExcel(file=fromPath, sheetName=desired_sheet)
flatten = List.Flatten(list=importExcel)

# group: LIST CONVERTED TO WORKSETS
python_script = Python(IN[0]=flatten)
# ---------- python_script.python (40 lines) ----------
import clr
clr.AddReference('ProtoGeometry')
from Autodesk.DesignScript.Geometry import *
# Import ToDSType(bool) extension method
clr.AddReference("RevitNodes")
import Revit
clr.ImportExtensions(Revit.Elements)
# Import geometry conversion extension methods
clr.ImportExtensions(Revit.GeometryConversion)
# Import DocumentManager and TransactionManager
clr.AddReference("RevitServices")
import RevitServices
from RevitServices.Persistence import DocumentManager
from RevitServices.Transactions import TransactionManager
from System.Collections.Generic import *
# Import RevitAPI
clr.AddReference("RevitAPI")
import Autodesk
from Autodesk.Revit.DB import *

doc = DocumentManager.Instance.CurrentDBDocument
uiapp = DocumentManager.Instance.CurrentUIApplication
app = uiapp.Application
uidoc=DocumentManager.Instance.CurrentUIApplication.ActiveUIDocument

worksetnames = IN[0]
mDoc = DocumentManager.Instance.CurrentDBDocument
newWorksets = list()

# Start Transaction
TransactionManager.Instance.EnsureInTransaction(doc)

for name in worksetnames:
	Workset.Create(mDoc,name)
	newWorksets.append(name)

# End Transaction
TransactionManager.Instance.TransactionTaskDone()

OUT = newWorksets
# ----------------------------------------
watch = Watch(python_script)
