# Dynamo graph _HH_AlignPlanViewsBetweenSheets.dyn (Dynamo 2.0.3.8810)

# note: Hart Howerton Dynamo Script Colour Coding

# group: SCRIPT TEMPLATE
# note: PACKAGE DEPENDENCIES ________________________________________________________
# SteamNodes
# note: DESCRIPTION
# After you have made your plan sheets, make sure you have one sheet that is properly aligned.
# Input the name of the sheet to the STEP 1 node and run the script. Views on all plan sheets should re-align to the desired template sheet view location.
# PLEASE DOUBLE CHECK THAT YOU HAVE ALL NECESSARY PACKAGES INSTALLED BEFORE RUNNING THIS SCRIPT.
# note: REVIT BUILD(S)
# 2018, 2019, 2020
# note: DYNAMO VERSION
# 2.0.3.0
# note: AUTHOR
# Jessica Brams-Miller
# note: DYNAMO FILE NAME
# _HH_AlignPlanViewsBetweenSheets.dyn

# group: OPERATIONS
# note: Procedures required to run the script

# group: INPUTS
# note: User Inputs Required

# group: OUTPUTS
# note: Outputs at the end of the script

# group: SHEET CATEGORY SELECTOR
categories = Categories(index=447)  # graph input
all_elements_of_category = ElementsOfCategory(Category=categories)

# group: STEP 1: ENTER TEMPLATE SHEET NAME HERE
template_sheet_name = CodeBlock { "FLOOR PLAN-FIRST FLOOR"; }

# group: FINDS TEMPLATE SHEET
code_block = CodeBlock { "Sheet Name"; }
getParameterValueByName = Element.GetParameterValueByName(element=all_elements_of_category, parameterName=code_block)
boolean = BoolSelector(false)  # graph input
contains = String.Contains(str=getParameterValueByName, searchFor=template_sheet_name, ignoreCase=boolean)
filterByBoolMask = List.FilterByBoolMask(list=all_elements_of_category, mask=contains)

# group: FINDS PLAN SHEETS ON WHICH VIEWS NEED TO ALIGN TO TEMPLATE SHEET
code_block_2 = CodeBlock { "Sheet Number"; }
getParameterValueByName_2 = Element.GetParameterValueByName(element=all_elements_of_category, parameterName=code_block_2)
code_block_3 = CodeBlock { "A2.0"; }
boolean_2 = BoolSelector(false)  # graph input
contains_2 = String.Contains(str=getParameterValueByName_2, searchFor=code_block_3, ignoreCase=boolean_2)
filterByBoolMask_2 = List.FilterByBoolMask(list=all_elements_of_category, mask=contains_2)

# group: VIEWS ALIGNED
alignSheetViewsFromTemplateSheet = Custom[Tool.AlignSheetViewsFromTemplateSheet](TemplateSheet=filterByBoolMask.in, Sheets=filterByBoolMask_2.in)  # Align views and schedules from a sheet template
